# Grasshopper definition ApproximateFunction.gh (Grasshopper 0.9.76)
# plug-ins: Owl.Accord.GH, Owl.GH

num = Number(Slider(200, range=0..1000))
domain = Domain("-20 to 20")
data = Data(Slider(1000, range=0..1000))
random = Random(Range=domain, Number=data, Seed=2)
random_2 = Random(Range=domain, Number=data, Seed="1")
num_2 = Number(random)
num_3 = Number(random_2)
panel = Panel("""2
10
10
1""")
S = Source(domain)
network = ConstructNetwork(Layers=panel, Activation=Slider(1, range=0..2), Alpha=2, Seed=123)
num_4 = Number(num)
num_5 = Number(num)

num_6 = Number(num_3)
num_7 = Number(num_2)

expression = Expression(x=num_7, y=num_6, Expression="(x+2*y-5)^2+(2*x+y-10)^2")
num_8 = Number(num_6)
num_9 = Number(num_7)
featurets = FeatureTensorSet(Feature0=flatten(num_9), Feature1=flatten(num_8))

num_10 = Number(expression)

num_11 = Number(num_10)
featurets_2 = FeatureTensorSet(Feature0=flatten(num_11))
bnd = Bounds(Numbers=num_11)
S_2 = Source(bnd)
mergets = MergeTSet(TensorSets=featurets)
mergets_2 = MergeTSet(TensorSets=featurets_2)
S_3 = Source(S_2)
remap = RemapTSet(TensorSet=mergets, Source=S, Target=Domain(0, 1))
remap_2 = RemapTSet(TensorSet=mergets_2, Source=S_3, Target=Domain(0, 1))
ts = TensorSet(remap)
ts_2 = TensorSet(remap_2)
backprop = Backpropagation(
    ActivationNetwork=network,
    Input=ts,
    Output=ts_2,
    LearningRate=0.01,
    Momentum=0.001,
    Epoch=10,
    Iterations=Slider(1000, range=0..10000))  # -> ActivationNetwork, Error
_2dpreview = NetworkPreview(Network=backprop.ActivationNetwork, Lines=Domain(1, 5), Radius=5)
an = ActivationNetwork(backprop.ActivationNetwork)
I = Input(ts)
compute = Compute(ActivationNetwork=an, Input=I)
S_4 = Source(S_2)
remap_3 = RemapTSet(TensorSet=compute, Source=Domain(0, 1), Target=S_4)
detset = DeconstructTensorSet(TensorSet=remap_3)
detensor = DeconstructTensor(Tensor=detset)
num_12 = Number(flatten(detensor))
num_13 = Number(num_7)
num_14 = Number(num_6)
num_15 = Number(num_10)
num_16 = Number(num_7)
num_17 = Number(num_6)
panel_2 = Panel(num_12)
cluster = Cluster(A=num_15, num=num_4)
num_18 = Number(num_12)
cluster_2 = Cluster(A=num_18, num=num_5)
pt = ConstructPoint(XCoordinate=num_16, YCoordinate=num_17, ZCoordinate=cluster)
pt_2 = ConstructPoint(XCoordinate=num_13, YCoordinate=num_14, ZCoordinate=cluster_2)
A = StartPoint(pt)
A_2 = StartPoint(A)
pt_3 = Point(pt_2)
cloud = CloudDisplay(Points=pt_3, Colours=ColourSwatch(SwatchColor=RGB(255, 10, 108)), Size=Slider(0.25, range=0..1), SpriteType=0)
cloud_2 = CloudDisplay(Points=A_2, Colours=ColourSwatch(SwatchColor=RGB(0, 166, 255)), Size=Slider(0.37, range=0..1), SpriteType=0)
patch = Patch(Points=A_2, Spans=20, Flexibility=1, Trim=True)
contour = Contour(Shape=patch, Point=Point(0, 0, 0), Direction=Vector(0, 0, 1), Distance=Slider(0.25, range=0..1))
ln = Line(StartPoint=A_2, EndPoint=pt_3)
curve = Curve(ln)
preview = CustomPreview(Geometry=contour, Shader=ColourSwatch(SwatchColor=RGB(214, 214, 214)))

# ==== cluster Cluster
num = ClusterInput()
A = ClusterInput()
num_2 = Number(num)
division = Division(A=A, B=num_2)
R = ClusterOutput(division)
