# Grasshopper definition HousePricePredictions.gh (Grasshopper 0.9.76)
# plug-ins: Owl.Accord.GH, Owl.GH

# Area
int = Integer([1689, 1984, 1581, 1829, 1580, 1621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])
# Inputs
# Age
int_2 = Integer([1978, 1958, 2002, 2004, 2006, 2005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])
# # Rooms
int_3 = Integer([4, 3, 3, 4, 4, 3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])
# Input Data
# Training Set
# Outputs
# Price
int_4 = Integer([270897, 302404, 2519996, 197193, 207897, 196559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])

subtraction = Subtraction(A=Slider(2017, range=0..10000), B=int_2)
multiplication = Multiplication(A=int_3, B=Slider(1000, range=0..1000))
multiplication_2 = Multiplication(A=subtraction, B=Slider(100, range=0..1000))

# ----
# Process Data
# Normalisation/Weighting
featurets = FeatureTensorSet(Feature0=int_4)
featurets_2 = FeatureTensorSet(Feature0=multiplication_2, Feature1=multiplication, Feature2=int)

# ----
# Assemble Vectors
panel = Panel("0 to 10000000")
remap = RemapTSet(TensorSet=featurets, Source=panel, Target=Domain(0, 1))
remap_2 = RemapTSet(TensorSet=featurets_2, Source="0 to 10000", Target=Domain(0, 1))
tensorset = TensorSet(remap)
tensorset_2 = TensorSet(remap_2)

# ----
# Configure Model
number_slider = Slider(3, range=0..10)
merge = Merge(Data1=number_slider, Data2=Slider(18, range=0..100), Data3=Slider(1, range=0..10))
network = ConstructNetwork(Layers=merge, Activation=Slider(1, range=0..10), Alpha=2, Seed=123)
panel_2 = Panel(merge)
tensorset_3 = TensorSet(tensorset)
tensorset_4 = TensorSet(tensorset_2)
# Train Model
mergets = MergeTSet(TensorSets=tensorset_3)
mergets_2 = MergeTSet(TensorSets=tensorset_4)
backprop = Backpropagation(
    ActivationNetwork=network,
    Input=mergets_2,
    Output=mergets,
    LearningRate=0.01,
    Momentum=0.001,
    Epoch=10,
    Iterations=Slider(800, range=0..10000))  # -> ActivationNetwork, Error
_2dpreview = NetworkPreview(Network=backprop.ActivationNetwork, Lines=Domain(1, 5), Radius=5)
tensorset_5 = TensorSet(tensorset_2)
number = Number(int_4)
an = ActivationNetwork(backprop.ActivationNetwork)
# Input Data
# Test Set
# *important to split training and test sets in practice
# Inputs
ts = TensorSet(tensorset_5)
# Outputs
int_5 = Integer(number)

# ----
# Validate Model
compute = Compute(ActivationNetwork=an, Input=ts)
remap_3 = RemapTSet(TensorSet=compute, Source=Domain(0, 1), Target="50000 to 5000000")

detset = DeconstructTensorSet(TensorSet=remap_3)
int_6 = Integer(int_5)
detensor = DeconstructTensor(Tensor=detset)  # -> flatten(Values)
# Compare Results
entwine = Entwine(Branch00=int_6, Branch01=detensor, FlattenInputs=True)
graph = QuickGraph(entwine)
panel_3 = Panel("Actual Sale Price")
panel_4 = Panel("Approximated Sale Price")
