# Grasshopper definition KMeansBoxesInSpace.gh (Grasshopper 0.9.76)
# plug-ins: Owl.GH

data = Data(Slider(100, range=0..100))
data_2 = Data(Slider(67, range=0..100))
data_3 = Data(Slider(5, range=0..100))
data_4 = Data(Slider(500, range=0..1000))
dom = ConstructDomain(DomainStart=data_3, DomainEnd=data_2)
dom_2 = ConstructDomain(DomainStart=0, DomainEnd=expr("x/2", data_4))
dom_3 = ConstructDomain(DomainStart=expr("x/2", data_4), DomainEnd=data_4)
domain = Domain(dom_2)
domain_2 = Domain(dom_3)

data_5 = Data(data)
domain_3 = Domain(domain)
domain_4 = Domain(domain_2)
box = DomainBox(Base=PlaneXY(0, 0, 0), X=domain_3, Y=domain_3, Z=domain_3)
box_2 = DomainBox(Base=PlaneXY(0, 0, 0), X=domain_4, Y=domain_4, Z=domain_4)
division = Division(A=data_5, B="2")
R = Region(box_2)
R_2 = Region(box)
data_6 = Data(division)
pop3d = Populate3D(Region=R_2, Count=data_6, Seed=1)
pop3d_2 = Populate3D(Region=R, Count=data_6, Seed=1)
merge = Merge(Data1=pop3d, Data2=pop3d_2)  # -> flatten(Result)
B = Base(merge)

# ----
# Generate Data
domain_5 = Domain(dom)
domain_6 = Domain(domain_5)
domain_7 = Domain(domain_5)
data_7 = Data(data)
random = Random(Range=domain_7, Number=data_7, Seed=2)
X = X(random)
box_3 = DomainBox(Base=B, X=X, Y=X, Z=X)
box_4 = Box(box_3)
box_5 = Box(box_4)
box_6 = Box(box_5)
volume = Volume(Geometry=box_6)  # -> Volume, Centroid
data_8 = Data(volume.Volume)

# ----
# by Volume
# by Location
number_slider = Slider(2, range=0..10)
number = Number(Slider(8, range=0..10))
number_2 = Number(number_slider)

# ----
# Normalize and Weight Data
data_9 = Data(data_8)
tensor = ConstructTensor(Values=simplify(graft(data_9)))  # -> flatten(Tensor)
number_3 = Number(Slider(0, range=0..1))
data_10 = Data(data_8)
number_4 = Number(number)
tensorset = ConstructTensorSet(Tensors=tensor)
bnd = Bounds(Numbers=data_10)
dom_4 = ConstructDomain(DomainStart=number_3, DomainEnd=number_4)
ts = TensorSet(tensorset)
domain_8 = Domain(dom_4)
domain_9 = Domain(bnd)
remap = RemapTSet(TensorSet=ts, Source=domain_9, Target=domain_8)
ts_2 = TensorSet(remap)

pt = Point(B)
domain_10 = Domain(domain_2)
T = Tensor(simplify(graft(pt)))
number_5 = Number(number_2)
dom_5 = ConstructDomain(DomainStart=number_3, DomainEnd=number_5)
tensorset_2 = ConstructTensorSet(Tensors=T)
domain_11 = Domain(dom_5)
ts_3 = TensorSet(tensorset_2)
remap_2 = RemapTSet(TensorSet=ts_3, Source=domain_10, Target=domain_11)  # -> graft(TensorSet)
ts_4 = TensorSet(remap_2)

detset = DeconstructTensorSet(TensorSet=ts_4)
# Construct Vector Set
detset_2 = DeconstructTensorSet(TensorSet=ts_2)
detensor = DeconstructTensor(Tensor=detset_2)  # -> simplify(Values)
detensor_2 = DeconstructTensor(Tensor=detset)  # -> simplify(Values)
merge_2 = Merge(Data1=detensor, Data2=detensor_2)
tensor_2 = ConstructTensor(Values=merge_2)  # -> flatten(Tensor)
tensorset_3 = ConstructTensorSet(Tensors=tensor_2)

# ----
# Number of Clusters
number_slider_2 = Slider(8, range=0..10)
int = Integer(number_slider_2)

# ----
# K-Means
ts_5 = TensorSet(tensorset_3)
int_2 = Integer(int)
kmeans = KMeansClustering(Data=ts_5, Clusters=int_2, Iterations=1, Seed=123)  # -> Clusters, Indices
int_3 = Integer(kmeans.Indices)

# ----
# Visualization
box_7 = Box(box_5)
int_4 = Integer(int_2)
int_5 = Integer(int_3)
L = List(box_7)
series = Series(Start=0, Step=1, Count=int_4)
item = ListItem(List=L, Index=int_5, Wrap=True)
int_6 = Integer(simplify(graft(series)))
gradient = Gradient(
    LowerLimit=0,
    UpperLimit=expr("x-1", int_4),
    Parameter=int_6,
    stops=[0: RGB(0, 123, 224), 0.5: RGB(255, 255, 0), 0.847: RGB(255, 0, 0), 1: RGB(59, 0, 117)])
G = Geometry(item)
S = Shader(gradient)
preview = CustomPreview(Geometry=G, Shader=S)
