# Grasshopper definition TrussModelPrediction.gh (Grasshopper 0.9.76)
# plug-ins: Dodo

# Design Variables: Truss Type
# Span
# Tributary Width
# Number of Bays
# Truss Depth
# Raise H
output = Panel("Structural Weight")
# Testing Set
# Inputs
num = Number(Tree({0}: [2, 26, 13, 28, 6, 5], {1}: [2, 22, 11, 26, 5, 3], {2}: [1, 1, 11, 26, 6, 1], {3}: [3, 11, 5, 26, 9, 6], {4}: [2, 12, 11, 20, 11, 2], {5}: [1, 14, 14, 10, 7, 11]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))
# Outputs
num_2 = Number(Tree({0}: [15556.85036], {1}: [12297.45022], {2}: [8227.636335], {3}: [13139.87225], {4}: [14467.59689], {5}: [7973.376827]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))
# Outputs
num_3 = Number(Tree({0}: [6856.305346], {1}: [6192.675577], {2}: [14467.87959], {3}: [18177.57096], {4}: [9429.10857], {5}: [9187.966386]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))
# Input Data
# Training Set
# Inputs
num_4 = Number(Tree({0}: [0, 50, 8, 16, 9, 3], {1}: [3, 17, 15, 6, 9, 2], {2}: [2, 8, 16, 16, 11, 7], {3}: [2, 6, 17, 28, 7, 8], {4}: [2, 31, 9, 8, 6, 7], {5}: [2, 2, 6, 8, 11, 6]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))
# Build Model
# Use/Test Model
trainnn = TrainNeuralNetwork(D=num_4, O=num_3)
nickname = GH_RunNN(NeuralNetwork=trainnn, Data=num)  # -> flatten(Data), Weights, Threshold
# Compare Results
# Force: Minimum
# Force: Maximum
# Force: Maximum Absolute
# Moment: Maximum Absolute
# Stress: Maximum
# Weight
# Cross Section: Max Weight: Weight
# Cross Section: Max Weight: Depth
# Cross Section: Max Weight: Name
# Cross Section: Max Depth: Depth
int = Integer(flatten(num_2))
int_2 = Integer(nickname.Data)
# Prediction
panel = Panel(int_2)
# Actual
panel_2 = Panel(int)
