# Grasshopper definition PCA_Basic.gh (Grasshopper 0.9.76)

data = Data(Slider(200, range=0..1000))
random = Random(Range="-1 to 1", Number=data, Seed="1")
random_2 = Random(Range="-2 to 2", Number=data, Seed="2")
random_3 = Random(Range="0 to 10", Number=data, Seed="0")
number = Number(random)
number_2 = Number(random_3)
number_3 = Number(random_2)
addition = Addition(A=number_2, B=number_3)
addition_2 = Addition(A=number_2, B=number)
number_4 = Number(number_2)
number_5 = Number(addition_2)
number_6 = Number(addition)
construct_point = ConstructPoint(XCoordinate=number_4, YCoordinate=number_5, ZCoordinate=number_6)
merge = Merge(Data1=simplify(graft(number_4)), Data2=simplify(graft(number_5)), Data3=simplify(graft(number_6)))
number_7 = Number(merge)
point = Point(construct_point)
number_8 = Number(number_7)
point_2 = Point(point)
cluster = Cluster(number=number_8)  # -> number_6, number_7
average = Average(Input=point_2)
number_9 = Number(cluster.number_6)
number_10 = Number(cluster.number_7)
point_3 = Point(average)
list_item = ListItem(List=number_10, Index=0, Wrap=True)  # -> Item, Item1, Item2
vector_xyz = VectorXYZ(XComponent=list_item.Item, YComponent=list_item.Item1, ZComponent=list_item.Item2)  # -> Vector, Length
vector = Vector(vector_xyz.Vector)
panel = Panel(vector)
point_4 = Point(point_3)
vector_2 = Vector(vector)
colour = Colour(RGB(0, 0, 0))
width = Width(Slider(5, range=0..10))
vector_display_ex = VectorDisplayEx(Point=point_4, Vector=vector_2, Colour=colour, Width=width)

# ==== cluster Cluster
number = ClusterInput()
number_2 = Number(number)
tree_statistics = TreeStatistics(Tree=number_2)  # -> Paths, Length, Count
list_item = ListItem(List=tree_statistics.Length, Index=0, Wrap=True)
number_3 = Number(flatten(number_2))
integer = Integer(tree_statistics.Count)
integer_2 = Integer(list_item)
panel = Panel(integer_2)
panel_2 = Panel(integer)
integer_3 = Integer(panel)
gh_cpython = GH_CPython(data=number_3, n_features=integer_2, n_samples=integer)  # -> components_list, X_tr_pca_list; inputs data: list, n_features: list, n_samples: list
# ---------- gh_cpython: Python ----------
# -*- coding: utf-8 -*-
""" 
Python Script
Created on  Friday July 2018 05:49:40 
@author:  Kam-Ming Mark Tam 

[desc]
Description of the plugin Here
Write here any thing... 
[/desc]

ARGUMENTS:
----------
<inp> 
    _input :[required] - [type = int] - [default = None] 
    Descripe your input here 
        * bullet point.
        * bullet point
</inp>
<inp>
    Other inputs go here ...
</inp>

RETURN:
----------
    <out>
        output_ : indicate your output description here. \n refers to a new line.
    </out>

"""

import numpy as np
import pickle


_data = np.reshape(_data,(_n_samples,_n_features))
print _data.shape

def main( _data):
    try:
        exec("from sklearn.decomposition import PCA")
        
        exec("pca = PCA()")
        
        try:
            X_tr_pca_ = pca.fit_transform(_data)
            components_ = pca.components_
            
            
            
            X_tr_pca_list_ = str(X_tr_pca_.flatten().tolist())
            components_list_ = str(components_.flatten().tolist())
            
            len_X_tr_pca_list_ = (len(X_tr_pca_list_))
            X_tr_pca_list_= X_tr_pca_list_[1:len_X_tr_pca_list_-2]
            
            len_components_list_ = (len(components_list_))
            components_list_= components_list_[1:len_components_list_-2]   

        except:
            print 'Failed fit'

    except Exception as e:
        print str(e)
        print 'Failed initialization'


    return X_tr_pca_list_,components_list_


has_data = _data is not None

if(all([has_data])):
    X_tr_pca_list_,components_list_ = main( _data)
else:
    print "Please Complete all the required data"
# ---------- end gh_cpython ----------
text_split = TextSplit(Text=gh_cpython.components_list, Separators=",")
text_split_2 = TextSplit(Text=gh_cpython.X_tr_pca_list, Separators=",")
data = Data(text_split_2)
data_2 = Data(text_split)
integer_4 = Integer(integer_3)
partition_list = PartitionList(List=data_2, Size=integer_4)  # -> simplify(Chunks)
partition_list_2 = PartitionList(List=data, Size=integer_4)  # -> simplify(Chunks)
number_4 = Number(partition_list_2)
number_5 = Number(partition_list)
number_6 = ClusterOutput(number_4)
number_7 = ClusterOutput(number_5)
