# Grasshopper definition PCA_ImageCompression.gh (Grasshopper 0.9.76)

count = Count(Slider(100, range=0..100))
count_2 = Count(count)
count_3 = Count(count_2)
addition = Addition(A=count_3, B="1")
count_4 = Count(addition)
count_5 = Count(count_2)
count_6 = Count(count_4)
count_7 = Count(count_6)
series = Series(Start=0, Step=expr("1/x", count_5), Count=count_7)
cross_reference = CrossReference(ListListA=series, ListListB=series, CrossMode=1)  # -> ListListA, ListListB
construct_point = ConstructPoint(XCoordinate=cross_reference.ListListA, YCoordinate=cross_reference.ListListB, ZCoordinate=0)
size = Size(count_4)
point = Point(construct_point)
partition_list = PartitionList(List=point, Size=size)  # -> simplify(Chunks)
point_2 = Point(partition_list)
point_3 = Point(partition_list)
image_sampler = ImageSampler(
    point_3,
    FilePath="C:\Users\Kam-Ming Mark Tam\Desktop\800px-Mona_Lisa,_by_Leonardo_da_Vinci,_from_C2RMF_retouched.jpg",
    Filter="Colour",
    Interpolate=True,
    Umax=1,
    Umin=0,
    Vmax=1,
    Vmin=0,
    Wrap=1)
data = Data(image_sampler)
data_2 = Data(",")
text_split = TextSplit(Text=data, Separators=data_2)
list_item = ListItem(List=text_split, Index=0, Wrap=True)  # -> Item, Item1, Item2
trim_tree = TrimTree(Tree=list_item.Item1, Depth=1)
trim_tree_2 = TrimTree(Tree=list_item.Item2, Depth=1)
trim_tree_3 = TrimTree(Tree=list_item.Item, Depth=1)
data_3 = Data(simplify(trim_tree_2))
data_4 = Data(simplify(trim_tree_3))
data_5 = Data(simplify(trim_tree))
integer = Integer(Slider(50, range=0..1000))
data_6 = Data(data_3)
data_7 = Data(data_4)
data_8 = Data(data_5)
number = Number(data_8)
integer_2 = Integer(integer)
integer_3 = Integer(integer)
number_2 = Number(data_6)
number_3 = Number(data_7)
integer_4 = Integer(integer)
cluster = Cluster(number=number_2, integer=integer_2)  # -> number_7, number_9, number_8
cluster_2 = Cluster(number=number_3, integer=integer_4)  # -> number_7, number_9, number_8
cluster_3 = Cluster(number=number, integer=integer_3)  # -> number_7, number_9, number_8
number_4 = Number(cluster_2.number_7)
number_5 = Number(cluster_2.number_9)
number_6 = Number(cluster_3.number_7)
number_7 = Number(cluster_3.number_9)
number_8 = Number(cluster.number_9)
number_9 = Number(cluster.number_7)
number_10 = Number(cluster_3.number_8)
number_11 = Number(cluster.number_8)
number_12 = Number(cluster_2.number_8)
colour_rgb = ColourRGB(Alpha=255, Red=number_12, Green=number_10, Blue=number_11)
colour_rgb_2 = ColourRGB(Alpha=255, Red=data_4, Green=data_5, Blue=data_3)
shader = Shader(colour_rgb)
geometry = Geometry(point_3)
# Original
custom_preview = CustomPreview(Geometry=point_3, Shader=colour_rgb_2)
# Transformed Data from n Components
custom_preview_2 = CustomPreview(Geometry=geometry, Shader=shader)

# ==== cluster Cluster
number = ClusterInput()
integer = ClusterInput()
number_2 = Number(number)
integer_2 = Integer(integer)
tree_statistics = TreeStatistics(Tree=number_2)  # -> Paths, Length, Count
list_item = ListItem(List=tree_statistics.Length, Index=0, Wrap=True)
number_3 = Number(flatten(number_2))
integer_3 = Integer(list_item)
integer_4 = Integer(tree_statistics.Count)
panel = Panel(integer_3)
panel_2 = Panel(integer_4)
gh_cpython = GH_CPython(data=number_3, n_features=integer_3, n_samples=integer_4, n_components=integer_2)  # -> components_list, X_tr_pca_list, X2_list; inputs data: list, n_features: list, n_samples: list, n_components: list
# ---------- gh_cpython: Python ----------
# -*- coding: utf-8 -*-
""" 
Python Script
Created on  Friday July 2018 05:49:40 
@author:  Kam-Ming Mark Tam 

[desc]
Description of the plugin Here
Write here any thing... 
[/desc]

ARGUMENTS:
----------
<inp> 
    _input :[required] - [type = int] - [default = None] 
    Descripe your input here 
        * bullet point.
        * bullet point
</inp>
<inp>
    Other inputs go here ...
</inp>

RETURN:
----------
    <out>
        output_ : indicate your output description here. \n refers to a new line.
    </out>

"""

import numpy as np
import pickle


_data = np.reshape(_data,(_n_samples,_n_features))


def main( _data, _n_components):
    try:
        exec("from sklearn.decomposition import PCA")
        
        exec("pca = PCA()")
        
        try:
            X_tr_pca_ = pca.fit_transform(_data)

            components_ = pca.components_
            components_re = components_[:,:_n_components]
            components_re_T = components_re.T
            
            X_tr2_pca_ = _data.dot(components_re)
            print X_tr2_pca_.shape
           

            X_tr2_pca_= _data.dot(components_re)
            X2 = X_tr2_pca_.dot(components_re_T)

            X2_list_ = str(X2.flatten().tolist())
            X_tr_pca_list_ = str(X_tr_pca_.flatten().tolist())
            components_list_ = str(components_.flatten().tolist())
            
            len_X_tr_pca_list_ = (len(X_tr_pca_list_))
            X_tr_pca_list_= X_tr_pca_list_[1:len_X_tr_pca_list_-2]
            
            len_components_list_ = (len(components_list_))
            components_list_= components_list_[1:len_components_list_-2]   

            len_X2_list_ = (len(X2_list_))
            X2_list_ = X2_list_[1:len_X2_list_-2]

        except:
            print 'Failed fit'

    except Exception as e:
        print str(e)
        print 'Failed initialization'


    return X_tr_pca_list_,components_list_,X2_list_


has_data = _data is not None

if(all([has_data])):
    X_tr_pca_list_,components_list_,X2_list_ = main( _data, _n_components)
else:
    print "Please Complete all the required data"
# ---------- end gh_cpython ----------
text_split = TextSplit(Text=gh_cpython.X_tr_pca_list, Separators=",")
text_split_2 = TextSplit(Text=gh_cpython.components_list, Separators=",")
text_split_3 = TextSplit(Text=gh_cpython.X2_list, Separators=",")
data = Data(text_split)
data_2 = Data(text_split_3)
data_3 = Data(text_split_2)
integer_5 = Integer(integer_4)
partition_list = PartitionList(List=data_3, Size=integer_5)  # -> simplify(Chunks)
partition_list_2 = PartitionList(List=data, Size=integer_5)  # -> simplify(Chunks)
partition_list_3 = PartitionList(List=data_2, Size=integer_5)  # -> simplify(Chunks)
number_4 = Number(partition_list)
number_5 = Number(partition_list_3)
number_6 = Number(partition_list_2)
number_7 = ClusterOutput(number_4)
number_8 = ClusterOutput(number_5)
number_9 = ClusterOutput(number_6)
