# Grasshopper definition Nonlinear_BeamDeflectionApproximation.gh (Grasshopper 0.9.76)
# plug-ins: treesloth01, LunchBoxML, Dodo, GH_CPython

series = Series(Start=0, Step=1, Count=10)
# span
number_slider = Slider(20, range=0..100)
# loading (psf)
number_slider_2 = Slider(100, range=0..100)
# trib span
number_slider_3 = Slider(10, range=0..100)
list_item = ListItem(List=series, Index=0, Wrap=True)  # -> Item, Item1, Item2, Item3, Item4
# error
number_slider_4 = Slider(0.95, range=0..10)
# moment of inertia (in^4)
number_slider_5 = Slider(500, range=0..1000)
seed = Seed(Slider(5000, range=0..10000))
integer = Integer(list_item.Item1)
integer_2 = Integer(list_item.Item3)
integer_3 = Integer(list_item.Item)
integer_4 = Integer(list_item.Item2)
integer_5 = Integer(list_item.Item4)
construct_domain = ConstructDomain(DomainStart=number_slider_2, DomainEnd=Slider(200, range=0..1000))
# ft
construct_domain_2 = ConstructDomain(DomainStart=number_slider_3, DomainEnd=Slider(10, range=0..100))
# ft
construct_domain_3 = ConstructDomain(DomainStart=number_slider, DomainEnd=Slider(40, range=0..100))
construct_domain_4 = ConstructDomain(DomainStart=number_slider_4, DomainEnd=Slider(1.05, range=0..10))
construct_domain_5 = ConstructDomain(DomainStart=number_slider_5, DomainEnd=Slider(1000, range=0..10000))
seed_2 = Seed(seed)
data = Data(construct_domain)
integer_6 = Integer(integer_5)
seed_3 = Seed(seed)
ksi = Slider(28000, range=0..100000)
data_2 = Data(construct_domain_2)
integer_7 = Integer(integer)
data_3 = Data(construct_domain_4)
random = Random(Range=data, Number=seed_2, Seed=integer_6)
random_2 = Random(Range=data_2, Number=seed_3, Seed=integer_7)
data_4 = Data(construct_domain_5)
data_5 = Data(data_3)
seed_4 = Seed(seed)
integer_8 = Integer(integer_2)
seed_5 = Seed(seed)
data_6 = Data(construct_domain_3)
seed_6 = Seed(integer_3)
data_7 = Data(data_4)
seed_7 = Seed(seed)
integer_9 = Integer(integer_4)
number = Number(random)
number_2 = Number(ksi)
number_3 = Number(random_2)
random_3 = Random(Range=data_5, Number=seed_4, Seed=integer_8)
random_4 = Random(Range=data_6, Number=seed_5, Seed=seed_6)
random_5 = Random(Range=data_7, Number=seed_7, Seed=integer_9)
multiplication = Multiplication(A=number_3, B=number)
multiplication_2 = Multiplication(A=number_2, B="1000")
number_4 = Number(random_4)
integer_10 = Integer(integer_4)
data_8 = Data("20 to 80")
seed_8 = Seed(seed)
number_5 = Number(multiplication)
number_6 = Number(random_3)
number_7 = Number(multiplication_2)
number_8 = Number(random_5)
multiplication_3 = Multiplication(A=number_4, B="12")
random_6 = Random(Range=data_8, Number=seed_8, Seed=integer_10)
division = Division(A=number_5, B="12")
# in
integer_11 = Integer(multiplication_3)
# lb/in
number_9 = Number(division)
expression = Expression(h=random_6, Expression="(b*h^3)/12")
number_10 = Number(number_8)
number_11 = Number(number_6)
number_12 = Number(number_7)
number_13 = Number(integer_11)
number_14 = Number(number_9)
expression_2 = Expression(w=number_14, L=number_13, E=number_12, I=number_10, alpha=number_11, Expression="((5*w*L^4)/(384*E*I))*alpha")
number_15 = Number(expression_2)
gh_cpython = GH_CPython(input="None")  # -> output; inputs input: list
# ---------- gh_cpython: Python ----------
# -*- coding: utf-8 -*-
""" 
Python Script
Created on  Friday July 2018 01:05:24 
@author:  Kam-Ming Mark Tam 

[desc]
Description of the plugin Here
Write here any thing... 
[/desc]

ARGUMENTS:
----------
<inp> 
    _input :[required] - [type = int] - [default = None] 
    Descripe your input here 
        * bullet point.
        * bullet point
</inp>
<inp>
    Other inputs go here ...
</inp>

RETURN:
----------
    <out>
        output_ : indicate your output description here. \n refers to a new line.
    </out>

"""
# ---------- end gh_cpython ----------
number_16 = Number(simplify(graft(number_15)))
number_17 = Number(simplify(graft(number_9)))
number_18 = Number(simplify(graft(integer_11)))
number_19 = Number(simplify(graft(number)))
number_20 = Number(simplify(graft(number_8)))
merge = Merge(Data1=number_18, Data2=number_17, Data3=number_20, Data4=number_19)
test = TestData(merge)
tree = Tree(test)
tree_statistics = TreeStatistics(Tree=tree)  # -> Paths, Length, Count
integer_12 = Integer(tree_statistics.Count)
number_21 = Number(Slider(0.9, range=0..1))
list = List(tree_statistics.Paths)
multiplication_4 = Multiplication(A=integer_12, B=number_21)
integer_13 = Integer(multiplication_4)
construct_domain_6 = ConstructDomain(DomainStart=expr("x+1", integer_13), DomainEnd=expr("x-1", integer_12))
construct_domain_7 = ConstructDomain(DomainStart=0, DomainEnd=integer_13)
sub_list = SubList(List=list, Domain=construct_domain_7, Wrap=True)  # -> List, Index
sub_list_2 = SubList(List=list, Domain=construct_domain_6, Wrap=True)  # -> List, Index
test_2 = TestData(number_16)
test_3 = TestData(test)
path = Path(sub_list.List)
path_2 = Path(sub_list_2.List)
tree_2 = Tree(test_3)
path_3 = Path(path_2)
tree_3 = Tree(test_3)
path_4 = Path(path)
tree_4 = Tree(test_2)
tree_5 = Tree(test_2)
tree_branch = TreeBranch(Tree=tree_2, Path=path_3, MaintainPaths=True)
tree_branch_2 = TreeBranch(Tree=tree_4, Path=path_3, MaintainPaths=True)
tree_branch_3 = TreeBranch(Tree=tree_5, Path=path_4, MaintainPaths=True)
tree_branch_4 = TreeBranch(Tree=tree_3, Path=path_4, MaintainPaths=True)
renumber_paths = RenumberPaths(Data=tree_branch)
renumber_paths_2 = RenumberPaths(Data=tree_branch_2)
tree_6 = Tree(tree_branch_4)
tree_7 = Tree(tree_branch_3)
tree_8 = Tree(renumber_paths)
tree_9 = Tree(renumber_paths_2)
list_item_2 = ListItem(List=tree_6, Index=0, Wrap=True)  # -> Item, Item1, Item2, Item3; disabled
n1 = N1(list_item_2.Item3)  # disabled
n1_2 = N1(list_item_2.Item1)  # disabled
n1_3 = N1(list_item_2.Item2)  # disabled
n1_4 = N1(list_item_2.Item)  # disabled
vector_from_numbers = VectorFromNumbers(N1=n1_4, N2=n1_2, N3=n1_3, N4=n1)  # disabled
dodo_vector = DodoVector(vector_from_numbers)  # disabled
inputs = Inputs(tree_6)  # disabled
test_4 = TestData()  # disabled
test_5 = TestData(tree_7)  # disabled
nonlinereg = NonlinearRegression(TestData=test_4, Inputs=inputs, Output=test_5, Degree=Slider(2, range=0..10), Complexity=100, RandomSeed=5)  # -> Result, Score, Error; disabled
panel = Panel(nonlinereg.Result)
panel_2 = Panel(nonlinereg.Error)  # disabled
dodo_vector_2 = DodoVector(dodo_vector)
number_22 = Number(number_15)
least_squares = LeastSquares(DodoVector=dodo_vector_2, Results=number_22, DodoData_DecompositionLeastSquares=0)
data_9 = Data(least_squares)
