# Grasshopper definition 160523_Crow_Showcase_Backpropagation.gh (Grasshopper 0.9.76)
# Copyright: Benjamin Felbrich
# plug-ins: Crow

# ----
# - create training input vectors
number_slider = Slider(1790, range=0..5555)
random = Random(Range=Domain(0, 1), Number="6", Seed=expr("x+8", number_slider))
random_2 = Random(Range=Domain(0, 1), Number="6", Seed=expr("x+1", number_slider))
random_3 = Random(Range=Domain(0, 1), Number="6", Seed=expr("x+2", number_slider))
series = Series(Start=0, Step=1, Count="6")
random_4 = Random(Range=Domain(0, 1), Number="6", Seed=number_slider)
pt = ConstructPoint(XCoordinate=random_4, YCoordinate=random_2, ZCoordinate=random_3)
int = Integer(series)
remap = RemapNumbers(Value=random, Source=Domain(0, 1), Target=Domain(0.05, 0.15))  # -> Mapped, Clipped
entwine = Entwine(Branch00=random_4, Branch01=random_2, Branch02=random_3, Branch03=random, FlattenInputs=True)  # -> simplify(Result)
xy = XYPlane(Origin=pt)
hsl = ColourHSL(Alpha=1, Hue=Slider(0.684, range=0..1), Saturation=1, Luminance=0.5)
tag = TextTag3D(Location=graft(xy), Text=simplify(graft(int)), Size=simplify(graft(remap.Mapped)), Colour=hsl, Justification=7)

flip = FlipMatrix(Data=entwine)

# ----
# - create training output vectors
number_slider_2 = Slider(0.307, range=0..1)
lng = ListLength(List=flatten(entwine))
dom = ConstructDomain(DomainStart=expr("x*-1", number_slider_2), DomainEnd=number_slider_2)
series_2 = Series(Start=0, Step=1, Count=lng)
partition = PartitionList(List=series_2, Size=4)  # -> simplify(Chunks)
addition = Addition(A=partition, B=Slider(1071, range=500..1400))
random_5 = Random(Range=dom, Number=1, Seed=addition)  # -> simplify(Random)
pshift = ShiftPaths(Data=random_5, Offset=-1)
addition_2 = Addition(A=flip, B=pshift)
max = Maximum(A=addition_2, B=0)
min = Minimum(A=max, B=1)
cluster = Cluster(H=Slider(0, range=0..0.2), L=min)  # -> C, P, R
tag_2 = TextTag3D(Location=cluster.P, Text=graft(int), Size=cluster.R, Colour=cluster.C, Justification=7)

# ----
# construct backpropagation network
# nr. of training cycles
# types of different network layers
# (0 = Sigmoid, 1 = Linear, 2 = Logarithmic, 3 = Sine, 4 = TanH)
# nr. of neurons per layer
panel = Panel("3000")
genes = GenePool(Decimals=0, Maximum=20, Minimum=1, Value=[4, 6])
genes_2 = GenePool(Decimals=0, Maximum=4, Minimum=0, Value=[1, 2])

backprop = CrowNetConstructorBackpropagationNetwork(LayerStructure=genes_2, NeuronCount=genes, LearningRate=Slider(0.15, range=0..1))

# ----
# train!
crow_bp = CrowEngineBackpropagation(Cycles=panel, CrowNetBackpropagation=backprop, TrainingInputVectors=flip, TrainingOutputVectors=min)  # -> MeanSquareError, Network

num = Number([Slider(0.37, range=0..1), Slider(0.81, range=0..1), Slider(0.27, range=0..1), Slider(0.96, range=0..1)])

# ----
# classify
bp_vc = BackpropagationVectorClassifier(CrowNet=crow_bp.Network, InputVector=num)

cluster_2 = Cluster(H=Slider(0.099, range=0..0.2), L=num)  # -> C, P, R
cluster_3 = Cluster(H=Slider(0.099, range=0..0.2), L=bp_vc)  # -> C, P, R
tag_3 = TextTag3D(Location=cluster_2.P, Text="Xi", Size=cluster_2.R, Colour=cluster_2.C, Justification=7)
tag_4 = TextTag3D(Location=cluster_3.P, Text="Xo", Size=cluster_3.R, Colour=cluster_3.C, Justification=7)

# ==== cluster Cluster
L = ClusterInput()
item = ListItem(List=L, Index=0, Wrap=True)  # -> Item, Item1, Item2, Item3
pt = ConstructPoint(XCoordinate=item.Item, YCoordinate=item.Item1, ZCoordinate=item.Item2)
remap = RemapNumbers(Value=item.Item3, Source=Domain(0, 1), Target=Domain(0.05, 0.15))  # -> simplify(Mapped), Clipped
xy = XYPlane(Origin=pt)
H = ClusterInput()
R = ClusterOutput(remap.Mapped)
hsl = ColourHSL(Alpha=1, Hue=H, Saturation=1, Luminance=0.5)
P = ClusterOutput(xy)
C = ClusterOutput(hsl)
