# Grasshopper definition 160523_Crow_Showcase_Backpropagation_2.gh (Grasshopper 0.9.76)
# Copyright: Benjamin Felbrich
# plug-ins: Crow

num = Number([Slider(0.642, range=0..1), Slider(0.802, range=0..1), Slider(0.499, range=0..1)])

# ----
# construct neural network
# nr. of training cycles
# types of different network layers
# (0 = Sigmoid, 1 = Linear, 2 = Logarithmic, 3 = Sine, 4 = TanH)
# nr. of neurons per layer
panel = Panel("""0
1
2
0""")
# Backpropagation Network for Supervised Learning
panel_2 = Panel("3000")
panel_3 = Panel("""4
5
8
3""")

# ----
# requested input vector
matrix = ConstructMatrix(Rows=1, Columns="3", Values=num)
matrix_2 = DisplayMatrix(matrix)

backprop = CrowNetConstructorBackpropagationNetwork(LayerStructure=panel, NeuronCount=panel_3, LearningRate=Slider(0.928, range=0..1))

# ----
# view as spheres
multiplication = Multiplication(A="4", B="3")
multiplication_2 = Multiplication(A="4", B="4")
range = Range(Domain=Domain(0, 1), Steps=expr("x-1", multiplication))
range_2 = Range(Domain=Domain(0, 1), Steps=expr("x-1", multiplication_2))
number_slider = Slider(2.219, range=0..4)
jitter = Jitter(List=range, Jitter=1, Seed=2)  # -> Values, Indices
jitter_2 = Jitter(List=range_2, Jitter=1, Seed=2)  # -> Values, Indices
series = Series(Start=0, Step=number_slider, Count="4")
series_2 = Series(Start=0, Step=number_slider, Count="3")
series_3 = Series(Start=0, Step=number_slider, Count="4")
X = UnitX(Factor=Slider(11.931, range=0..15))
pt = ConstructPoint(XCoordinate=graft(series), YCoordinate=series_2, ZCoordinate=0)
pt_2 = ConstructPoint(XCoordinate=0, YCoordinate=series_2, ZCoordinate=0)
pt_3 = ConstructPoint(XCoordinate=graft(series), YCoordinate=series_3, ZCoordinate=0)
move = Move(Geometry=pt_3, Motion=X)  # -> Geometry, Transform
sph = Sphere(Base=flatten(move.Geometry), Radius=expr("x+0.01", jitter_2.Values))
sph_2 = Sphere(Base=flatten(pt), Radius=expr("x+0.01", jitter.Values))
Y = UnitY(Factor=Slider(-9.434, range=-15..1))
move_2 = Move(Geometry=pt_2, Motion=Y)  # -> Geometry, Transform
addition = Addition(A=Y, B=X)
unflatten = UnflattenTree(Tree=sph_2, Guide=pt)
unflatten_2 = UnflattenTree(Tree=sph, Guide=move.Geometry)
sph_3 = Sphere(Base=move_2.Geometry, Radius=expr("x+0.01", num))
pt_4 = ConstructPoint(XCoordinate=0, YCoordinate=series, ZCoordinate=0)
move_3 = Move(Geometry=pt_4, Motion=addition)  # -> Geometry, Transform
col = Colour(graft([ColourSwatch(SwatchColor=RGB(55, 106, 189)), ColourSwatch(SwatchColor=RGB(199, 32, 32)), ColourSwatch(SwatchColor=RGB(66, 148, 41)), ColourSwatch(SwatchColor=RGB(175, 64, 255))]))
preview = CustomPreview(Geometry=sph_3, Shader=ColourSwatch(SwatchColor=RGB(255, 142, 107)))
preview_2 = CustomPreview(Geometry=unflatten, Shader=col)
preview_3 = CustomPreview(Geometry=unflatten_2, Shader=col)

partition = PartitionList(List=jitter.Values, Size=[3, 3, 3, 3])  # -> simplify(Chunks)
partition_2 = PartitionList(List=jitter_2.Values, Size=[4, 4, 4, 4])  # -> simplify(Chunks)

# ----
# Learning Input Matrix
matrix_3 = ConstructMatrix(Rows="4", Columns="3", Values=jitter.Values)
matrix_4 = DisplayMatrix(matrix_3)

# ----
# Learning Output Matrix
matrix_5 = ConstructMatrix(Rows="4", Columns="4", Values=jitter_2.Values)
matrix_6 = DisplayMatrix(matrix_5)

crow_bp = CrowEngineBackpropagation(Cycles=panel_2, CrowNetBackpropagation=backprop, TrainingInputVectors=partition, TrainingOutputVectors=partition_2)  # -> MeanSquareError, Network
bp_vc = BackpropagationVectorClassifier(CrowNet=crow_bp.Network, InputVector=num)

sph_4 = Sphere(Base=move_3.Geometry, Radius=expr("x+0.01", bp_vc))
preview_4 = CustomPreview(Geometry=sph_4, Shader=ColourSwatch(SwatchColor=RGB(255, 142, 107)))
