# Grasshopper definition 160523_Crow_Showcase_Kohonen2D.gh (Grasshopper 0.9.76)
# plug-ins: Crow

# ----
# - create input vectors
# - build parametric model from input
#   vectors (in this case: colored cubes)
number_slider = Slider(3960, range=0..5555)
random = Random(Range=Domain(0, 10), Number="30", Seed=expr("x+1", number_slider))
random_2 = Random(Range=Domain(0, 5), Number="30", Seed=expr("x+2", number_slider))
random_3 = Random(Range=Domain(0, 10), Number="30", Seed=number_slider)
pt = ConstructPoint(XCoordinate=random_3, YCoordinate=random, ZCoordinate=random_2)
xz = XZPlane(Origin=Point(0, 0, 0))
mirror = Mirror(Geometry=pt, Plane=xz)  # -> Geometry, Transform

# ----
# Set up Self Organizing Map
number_slider_2 = Slider(0.2, range=0..1)
som_2d = CrowNetConstructorSelfOrganizingMap2D(
    LayerWidth=Slider(54, range=0..100),
    LayerHeight=Slider(84, range=0..100),
    CircularRows=Toggle(False),
    CircularColumns=Toggle(False),
    LatticeTopology=Toggle(False),
    NeighborhoodFunction=Toggle(False),
    LearningRate=number_slider_2)

pt_2 = Point([mirror.Geometry, pt])
crow_som_2d = CrowEngineSelfOrganizingMaps2D(TrainingCycles="5000", CrowNetSOM2D=som_2d, Points=pt_2, Go=Toggle(False))  # -> TrainingCycles, CrowNet
panel = Panel(crow_som_2d.TrainingCycles)
som_2d_mesh = _2DSOMMeshDisplay(CrowNet=crow_som_2d.CrowNet)
som_2d_points = _2DSOMPointDisplay(CrowNet=crow_som_2d.CrowNet)  # -> AllPoints, WinnerPoints
som_2d_grid = _2DSOMGridDisplay(CrowNet=crow_som_2d.CrowNet)  # -> GridRows, GridColumns, HexagonalRows
