# Grasshopper definition CrowExample_KohonenSOG_Planes.gh (Grasshopper 0.9.76)
# plug-ins: Crow

pln = Plane(flatten(Tree({0}: [Plane(origin=(1939.20337, 163.1066871, 1685.927125), x=(0.2185859205, -0.9695616116, 0.1103198834), y=(-0.3298878204, -0.1798196191, -0.9267356314))], {1}: [Plane(origin=(1751.212011, -34.25658342, 1791.141433), x=(-0.8671723037, 0.4456866781, 0.222206167), y=(-0.3298878204, -0.1798196191, -0.9267356314))], {2}: [Plane(origin=(1701.585619, 251.1859494, 1753.420832), x=(0.8170928628, 0.4372703535, -0.375704527), y=(-0.3298878204, -0.1798196191, -0.9267356314))], {3}: [Plane(origin=(2187.279267, 229.6543838, 1987.788686), x=(0.1397751609, -0.9381349227, 0.3168055733), y=(0.8707688545, -0.03586285978, -0.4903829701))], {4}: [Plane(origin=(2095.244409, -5.972635779, 1841.595133), x=(-0.4615943809, 0.2839578574, -0.8404157083), y=(0.8707688545, -0.03586285978, -0.4903829701))], {5}: [Plane(origin=(2061.72597, 273.0466673, 1761.671389), x=(0.41151494, 0.5989991742, 0.6869173484), y=(0.8707688545, -0.03586285978, -0.4903829701))]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)))
xy = XYPlane(Origin=Point(0, 0, 0))
jitter = Jitter(List=pln, Jitter=1, Seed=2)  # -> Values, Indices
panel = Panel("""4
6
8""")
som_g = CrowNetConstructorSelfOrganizingMapGeneric(LayerDimensions=panel, NeighborhoodFunction=False, LearningRate=0.2)
plane2pose = CSharpScript(refPlane=xy, Planes=jitter.Values)  # -> out, x, y, z, a, b, c; inputs refPlane: Plane, Planes: list of Plane
# ---------- plane2pose: C# ----------
    List<double> X = new List<double>();
    List<double> Y = new List<double>();
    List<double> Z = new List<double>();
    List<double> A = new List<double>();
    List<double> B = new List<double>();
    List<double> C = new List<double>();

    for(int i = 0; i < Planes.Count; i++)
    {
      double[] pose = PoseXYZABC(refPlane, Planes[i]);

      X.Add(pose[0]);
      Y.Add(pose[1]);
      Z.Add(pose[2]);
      A.Add(pose[3]);
      B.Add(pose[4]);
      C.Add(pose[5]);
    }

    x = X;
    y = Y;
    z = Z;
    a = A;
    b = B;
    c = C;
# ---------- plane2pose: C# additional code ----------
  public static double[] PoseXYZABC(Plane basePlane, Plane plane)
  {
    Quaternion q = Quaternion.Rotation(basePlane, plane);
    double[] dbl = new double[6];

    dbl[0] = plane.Origin.X - basePlane.OriginX;
    dbl[1] = plane.Origin.Y - basePlane.OriginY;
    dbl[2] = plane.Origin.Z - basePlane.OriginZ;
    dbl[3] = Math.Atan2(2.0 * (q.A * q.D + q.B * q.C), 1.0 - 2.0 * (q.C * q.C + q.D * q.D));
    dbl[4] = Math.Asin(2.0 * (q.A * q.C - q.B * q.D));
    dbl[5] = Math.Atan2(2.0 * (q.A * q.B + q.C * q.D), 1.0 - 2.0 * (q.B * q.B + q.C * q.C));

    return dbl;
  }
# ---------- end plane2pose ----------
merge = Merge(
    Data1=graft(plane2pose.x),
    Data2=graft(plane2pose.y),
    Data3=graft(plane2pose.z),
    Data4=graft(plane2pose.a),
    Data5=graft(plane2pose.b),
    Data6=graft(plane2pose.c))  # -> simplify(Result)

# ----
# Right click for boost
# (if neuron count > 500)
crow_som_g = CrowEngineSelfOrganizingMapsGeneric(TrainingCycles="500", CrowNetSOMG=som_g, TrainingVectors=merge, Start=Toggle(False))  # -> TrainingCyclesAndTiming, CrowNet

panel_2 = Panel(crow_som_g.TrainingCyclesAndTiming)
som_g_data = GenericSOMDisplay(CrowNet=crow_som_g.CrowNet)  # -> DataVectors, Points, AdressStructure, WinnerIndex
som_g_grid = GenericSOMGridDisplay(CrowNet=crow_som_g.CrowNet, XYZDimensionIndicesOptional=[0, 1, 2], TopologyDimensionIndicesOptional=[0, 1, 2])  # -> _1st, _2nd, _3rd
item = ListItem(List=som_g_data.DataVectors, Index=0, Wrap=True)  # -> Item, Item1, Item2, Item3, Item4, Item5
pose2plane = CSharpScript(x=item.Item, y=item.Item1, z=item.Item2, a=item.Item3, b=item.Item4, c=item.Item5)  # -> out, Planes; inputs x: list of Double, y: list of Double, z: list of Double, a: list of Double, b: list of Double, c: list of Double
# ---------- pose2plane: C# ----------
    List<Plane> planes = new List<Plane>();

    for(int i = 0; i < x.Count; i++)
    {
      planes.Add(PlaneFromXYZABC(x[i], y[i], z[i], a[i], b[i], c[i]));
    }

    Planes = planes;
# ---------- pose2plane: C# additional code ----------
  public static Plane PlaneFromXYZABC(double x, double y, double z, double a, double b, double c)
  {
    Plane plane = Plane.WorldXY;
    plane.Rotate(a, Vector3d.ZAxis);
    plane.Rotate(b, plane.YAxis);
    plane.Rotate(c, plane.XAxis);

    plane.Origin = new Point3d(x, y, z);
    return plane;
  }
# ---------- end pose2plane ----------
