# Grasshopper definition fruit_classification.gh (Grasshopper 0.9.76)
# plug-ins: Crow

# ----
# Generate trainIn
# data
number_slider = Slider(20, range=1..100)
ideal_curves = Curve([<curve referenced from the Rhino model> x5])
randomizecrv = CSharpScript(crv=ideal_curves, count=number_slider, range="2")  # -> out, simplify(A); inputs crv: Curve, count: Int32, range: Double
# ---------- randomizecrv: C# ----------
    //randomizes crv ctrl point position

    List<Curve> crvs = new List<Curve>();

    for(int cc = 0; cc < count; cc++)
    {
      List<Point3d> pts = new List<Point3d>();
      pts.Add(crv.ToNurbsCurve().Points[0].Location);
      for(int i = 1; i < crv.ToNurbsCurve().Points.Count; i++)
        pts.Add(crv.ToNurbsCurve().Points[i].Location);

      List<Point3d> nl = new List<Point3d>();
      for(int i = 0; i < pts.Count; i++)
      {
        bool go = true;
        for(int j = 0; j < i; j++)
        {
          if(i != j && pts[i] == pts[j])
            go = false;
        }
        if(go)
          nl.Add(pts[i]);
      }

      for(int i = 0; i < nl.Count; i++)
        nl[i] = new Point3d(nl[i].X + (rand.NextDouble() - 0.5) * 2 * range,
          nl[i].Y + (rand.NextDouble() - 0.5) * 2 * range,
          nl[i].Z + (rand.NextDouble() - 0.5) * 2 * range);


      nl.Add(nl[0]);
      crvs.Add(Curve.CreateControlPointCurve(nl, 3));
    }

    A = crvs;
# ---------- randomizecrv: C# additional code ----------
  Random rand = new Random();
# ---------- end randomizecrv ----------
crv2vec = CSharpScript(crv=flatten(randomizecrv.A), res="30")  # -> out, A, B, simplify(vec); inputs crv: Curve, res: Int32
# ---------- crv2vec: C# ----------
    
    //turns crv into double vector by measuring square distance of crv division points to center
    double resF = 1.0 / (double) res;

    crv.Domain = new Interval(0.0, 1.0);

    double[] T = crv.DivideByCount(res, true);
    List<Point3d> pts = new List<Point3d>();
    Point3d centerPt = new Point3d(0.0, 0.0, 0.0);
    List<double> vector = new List<double>();
    foreach(double t in T)
    {
      Point3d newPt = crv.PointAt(t);
      pts.Add(newPt);
      centerPt.X += newPt.X * resF;
      centerPt.Y += newPt.Y * resF;
      centerPt.Z += newPt.Z * resF;
    }

    foreach(Point3d p in pts)
    {
      vector.Add(Math.Pow(centerPt.X - p.X, 2)
        + Math.Pow(centerPt.Y - p.Y, 2)
        + Math.Pow(centerPt.Z - p.Z, 2));
    }

    A = pts;
    B = centerPt;
    vec = NormalizeVector(vector);
# ---------- crv2vec: C# additional code ----------
  public List<double> NormalizeVector(List<double> rawVec)
  {
    List<double> newList = new List<double>();
    double max = 0.0;
    foreach(double c in rawVec)
      if(c > max) max = c;

    foreach(double d in rawVec)
      newList.Add(d / max);

    return newList;
  }
# ---------- end crv2vec ----------

# ----
# Generate Training output
panel = Panel("""1
0
0
0
0""")
panel_2 = Panel("""0
1
0
0
0""")
panel_3 = Panel("""0
0
1
0
0""")
panel_4 = Panel("""0
0
0
1
0""")
panel_5 = Panel("""0
0
0
0
1""")
dup = DuplicateData(Data=graft(panel_3), Number=number_slider, Order=True)
dup_2 = DuplicateData(Data=graft(panel_2), Number=number_slider, Order=True)
dup_3 = DuplicateData(Data=graft(panel_5), Number=number_slider, Order=True)
dup_4 = DuplicateData(Data=graft(panel_4), Number=number_slider, Order=True)
dup_5 = DuplicateData(Data=graft(panel), Number=number_slider, Order=True)
flip = FlipMatrix(Data=[dup_5, dup_2, dup, dup_4, dup_3])  # -> simplify(Data)

curvepoint = PointOnCurve(ideal_curves, parameter=0.5)
points = PointList(Points=curvepoint, Size=Slider(3, range=0..10))
panel_6 = Panel(flip)

# ----
# Network
# layout
panel_7 = Panel("""0
0""")
panel_8 = Panel("""10
10""")
backprop = CrowNetConstructorBackpropagationNetwork(LayerStructure=panel_7, NeuronCount=panel_8, LearningRate=0.2)

# ----
# Input
# note:
# start drawing a curve
# at the bottom and go
# clock wise
crv = Curve(<curve referenced from the Rhino model>)

crv2vec_2 = CSharpScript(crv=flatten(crv), res="30")  # -> out, A, B, simplify(vec); inputs crv: Curve, res: Int32
# ---------- crv2vec_2: C# ----------
    if(!crv.IsClosed) throw new Exception("Curve must be closed");

    //turns crv into double vector by measuring square distance of crv division points to center
    double resF = 1.0 / (double) res;

    crv.Domain = new Interval(0.0, 1.0);

    double[] T = crv.DivideByCount(res, true);
    List<Point3d> pts = new List<Point3d>();
    Point3d centerPt = new Point3d(0.0, 0.0, 0.0);
    List<double> vector = new List<double>();
    foreach(double t in T)
    {
      Point3d newPt = crv.PointAt(t);
      pts.Add(newPt);
      centerPt.X += newPt.X * resF;
      centerPt.Y += newPt.Y * resF;
      centerPt.Z += newPt.Z * resF;
    }

    foreach(Point3d p in pts)
    {
      vector.Add(Math.Pow(centerPt.X - p.X, 2)
        + Math.Pow(centerPt.Y - p.Y, 2)
        + Math.Pow(centerPt.Z - p.Z, 2));
    }

    A = pts;
    B = centerPt;
    vec = NormalizeVector(vector);
# ---------- crv2vec_2: C# additional code ----------
  public List<double> NormalizeVector(List<double> rawVec)
  {
    List<double> newList = new List<double>();
    double max = 0.0;
    foreach(double c in rawVec)
      if(c > max) max = c;

    foreach(double d in rawVec)
      newList.Add(d / max);

    return newList;
  }
# ---------- end crv2vec_2 ----------

# ----
# Training
crow_bp = CrowEngineBackpropagation(Cycles=1000, CrowNetBackpropagation=backprop, TrainingInputVectors=crv2vec.vec, TrainingOutputVectors=flip)  # -> MeanSquareError, Network

bbox = BoundingBox(Content=crv2vec_2.A, Plane=PlaneXY(0, 0, 0), UnionBox=True)  # -> Box, Box_2
debox = DeconstructBox(Box=bbox.Box)  # -> Plane, X, Y, Z

# ----
# Classification
bp_vc = BackpropagationVectorClassifier(CrowNet=crow_bp.Network, InputVector=crv2vec_2.vec)

num = Number(debox.X)

panel_9 = Panel(bp_vc)
int = Integer(bp_vc)
int_2 = Integer(1)
index = CSharpScript(L=int, I=int_2)  # -> i; inputs L: list of Int32, I: Int32
# ---------- index: C# ----------
    for(int index = 0; index < L.Count; index++)
    {
      if(L[index] == I)
        i = index;
    }
# ---------- end index ----------
panel_10 = Panel(int)
item = ListItem(List=index, Index=0, Wrap=True)
panel_11 = Panel(item)

# ----
# Object
# library
mesh = Mesh([<mesh referenced from the Rhino model> x5])

item_2 = ListItem(List=mesh, Index=item, Wrap=True)
preview = CustomPreview(Geometry=item_2, Shader=ColourSwatch(SwatchColor=RGB(130, 130, 130)))

scale = Scale(Geometry=item_2, Center=Point(0, 0, 0), Factor=0.1)  # -> Geometry, Transform
scale_2 = Scale(Geometry=scale.Geometry, Center=Point(0, 0, 0), Factor=num)  # -> Geometry, Transform
move = Move(Geometry=scale_2.Geometry, Motion=crv2vec_2.B)  # -> Geometry, Transform
