# Grasshopper definition test_ant_fixed_component.gh (Grasshopper 0.9.76)
# plug-ins: GH_CPython

panel = Panel("""1
2
3
4
5
6
7
8
9
10
11
12
13
14
15
16
17
18
19
20
21
22
23
24""")
panel_2 = Panel("""4.375159448
4.9634527
6.418240738
8.772578574
10.54169161
12.31596849
14.16206696
16.36095729
18.12596007
20.44945136
22.10819512
24.65473901
26.86479793
28.65672936
30.35120478
32.80516287
34.57867306
36.20478352
38.66887514
40.09365205
42.36235914
44.19516398
46.83347079
48.98173502""")
merge = Merge(Data1=Slider(2.5, range=0..10), Data2=Slider(3, range=0..10))
count = Count(Slider(100, range=0..100))
value_list = ValueList({"1 : ARDRegression": 1, "2 : BayesianRidge": 2, "3 : ElasticNet": 3, "4 : ElasticNetCV": 4, "5 : Lars": 5, "6 : LarsCV": 6, "7 : Lasso": 7, "8 : LassoCV": 8, "9 : LassoLars": 9, "10 : LassoLarsCV": 10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}, selected="12 : LinearRegression": 12)
number = Number(merge)
count_2 = Count(count)
count_3 = Count(count_2)
addition = Addition(A=count_3, B="1")
number_2 = Number(panel)
number_3 = Number(panel_2)
count_4 = Count(addition)
ant_linear_models = ANT_LinearModels(data=number_2, target=number_3, predict=number, algorithm=value_list)  # -> log, output, score, out_model; inputs data: list, target: list, features: list, predict: list, algorithm: list, parameters: list
#   port score: the score of the prediction
# ---------- ant_linear_models: Python ----------
# -*- coding: utf-8 -*-
""" 
Python Script
Created on  Sunday August 2017 10:17:41 
@author:  Mahmoud AbdelRahman

[desc]
The sklearn.linear_model module implements generalized linear models. 
It includes Ridge regression, Bayesian Regression, Lasso and Elastic Net estimators 
computed with Least Angle Regression and coordinate descent.
It also implements Stochastic Gradient Descent related algorithms.
[/desc]

ARGUMENTS:  
----------
    <inp> _data : 
        data </inp>
    <inp>_target : 
        target </inp>
    <inp>_features : 
        features </inp>
    <inp>_predict : 
        predict </inp>
    <inp>_algorithm : [optional] - [int] - [12]
        
        Linear Model algorithm 
        Default is 12 i.e. LinearRegression

            Options: 

                1-> ARDRegression ---- Bayesian ARD regression.
                2-> BayesianRidge ---- Bayesian ridge regression
                3-> ElasticNet ---- Linear regression with combined L1 and L2 priors as regularizer.
                4-> ElasticNetCV ---- Elastic Net model with iterative fitting along a regularization path
                5-> Lars ---- Least Angle Regression model a.k.a.
                6-> LarsCV ---- Cross-validated Least Angle Regression model
                7-> Lasso ---- Linear Model trained with L1 prior as regularizer (aka the Lasso)
                8-> LassoCV ---- Lasso linear model with iterative fitting along a regularization path
                9-> LassoLars ---- Lasso model fit with Least Angle Regression a.k.a.
                10-> LassoLarsCV ---- Cross-validated Lasso, using the LARS algorithm
                11-> LassoLarsIC ---- Lasso model fit with Lars using BIC or AIC for model selection
                12-> LinearRegression ---- Ordinary least squares Linear Regression.
                13-> LogisticRegression ---- Logistic Regression (aka logit, MaxEnt) classifier.
                14-> LogisticRegressionCV ---- Logistic Regression CV (aka logit, MaxEnt) classifier.
                15-> MultiTaskLasso ---- Multi-task Lasso model trained with L1/L2 mixed-norm as regularizer
                16-> MultiTaskElasticNet ---- Multi-task ElasticNet model trained with L1/L2 mixed-norm as regularizer
                17-> MultiTaskLassoCV ---- Multi-task L1/L2 Lasso with built-in cross-validation.
                18-> MultiTaskElasticNetCV ---- Multi-task L1/L2 ElasticNet with built-in cross-validation.
                19-> OrthogonalMatchingPursuit ---- Orthogonal Matching Pursuit model (OMP)
                20-> OrthogonalMatchingPursuitCV ---- Cross-validated Orthogonal Matching Pursuit model (OMP)
                21-> PassiveAggressiveClassifier ---- Passive Aggressive Classifier
                22-> PassiveAggressiveRegressor ---- Passive Aggressive Regressor
                23-> Perceptron ---- Read more in the User Guide.
                24-> RandomizedLasso ---- Randomized Lasso.
                25-> RandomizedLogisticRegression ---- Randomized Logistic Regression
                26-> RANSACRegressor ---- RANSAC (RANdom SAmple Consensus) algorithm.
                27-> Ridge ---- Linear least squares with l2 regularization.
                28-> RidgeClassifier ---- Classifier using Ridge regression.
                29-> RidgeClassifierCV ---- Ridge classifier with built-in cross-validation.
                30-> RidgeCV ---- Ridge regression with built-in cross-validation.
                31-> SGDClassifier ---- Linear classifiers (SVM, logistic regression, a.o.) with SGD training.
                32-> SGDRegressor ---- Linear model fitted by minimizing a regularized empirical loss with SGD
                33-> TheilSenRegressor ---- Theil-Sen Estimator: robust multivariate regression model.
                34-> lars_path ---- Compute Least Angle Regression or Lasso path using LARS algorithm [1]
                35-> lasso_path ---- Compute Lasso path with coordinate descent
                36-> lasso_stability_path ---- Stability path based on randomized Lasso estimates
                37-> logistic_regression_path ---- Compute a Logistic Regression model for a list of regularization parameters.
                38-> orthogonal_mp ---- Orthogonal Matching Pursuit (OMP)
                39-> orthogonal_mp_gram ---- Gram Orthogonal Matching Pursuit (OMP)
    </inp>
    <inp>_parameters_ : [optional]
        Parameters of the Linear models - if omitted, it will be set to default values</inp>


RETURN: 
    log_ = output log
    output_ = predict Data
    score_ score value
"""


import numpy as np
import pickle


_data = np.array(_data).reshape((-1, 1))
_target = np.array(_target)
_predict = np.array(_predict).reshape((-1,1))

def main( _data, _target, _features, _predict, _algorithm = 12):
    ''' This is the main function '''
    allModels = {1:"ARDRegression",                 2:"BayesianRidge",                  3:"ElasticNet",                     4:"ElasticNetCV",
                 5:"Lars",                          6:"LarsCV",                         7:"Lasso",                          8:"LassoCV",
                 9:"LassoLars",                     10:"LassoLarsCV",                   11:"LassoLarsIC",                   12:"LinearRegression",
                 13:"LogisticRegression",           14:"LogisticRegressionCV",          15:"MultiTaskLasso",                16:"MultiTaskElasticNet",
                 17:"MultiTaskLassoCV",             18:"MultiTaskElasticNetCV",         19:"OrthogonalMatchingPursuit",     20:"OrthogonalMatchingPursuitCV",
                 21:"PassiveAggressiveClassifier",  22:"PassiveAggressiveRegressor",    23:"Perceptron",                    24:"RandomizedLasso",
                 25:"RandomizedLogisticRegression", 26:"RANSACRegressor",               27:"Ridge",                         28:"RidgeClassifier",
                 29:"RidgeClassifierCV",            30:"RidgeCV",                       31:"SGDClassifier",                 32:"SGDRegressor",
                 33:"TheilSenRegressor",            34:"lars_path",                     35:"lasso_path",                    36:"lasso_stability_path",
                 37:"logistic_regression_path",     38:"orthogonal_mp",                 39:"orthogonal_mp_gram"}
    try:
        exec("from sklearn.linear_model import "+ allModels[_algorithm]+"\n"
             + "log = "+ allModels[_algorithm]+".__doc__")
        
        exec("model = "+allModels[_algorithm]+"()")
        
        try:
            import pickle 
            model.fit(_data, _target)
            prediction = model.predict(_predict)
            score = model.score(_data, _target)
            out_model=model

            ##cp.dump(out_model, open("save.p", "wb"))
        except:

            print hello
            f1 = open(_data, 'r')
            f2 = open(_target, 'r')
            data1 = f1.read()
            target1 = f2.read()
            f1.close()
            f2.close()
            model.fit(pickle.loads(data1), pickle.loads(target1))
            prediction = model.predict(_predict)
            score = model.score(pickle.loads(data1),pickle.loads(target1))
            
    except Exception as e:
        print str(e)
    
    return [log, prediction, score, out_model]


has_data = _data is not None
has_target = _target is not  None
has_predict = _predict is not  None

if(all([has_data,has_target,has_predict])):
    if (_algorithm == None):
        _algorithm = 12
    log_, output_, score_, out_model_ = main( _data, _target, _features, _predict, _algorithm)
else:
    print "Please Complete all the required data"
# ---------- end ant_linear_models ----------
count_5 = Count(count_2)
count_6 = Count(count_4)
count_7 = Count(count_6)
series = Series(Start=0, Step=expr("1/x", count_5), Count=count_7)
cross_reference = CrossReference(ListListA=series, ListListB=series, CrossMode=1)  # -> ListListA, ListListB
gh_cpython = GH_CPython(model=ant_linear_models.out_model)  # -> output; inputs model: list
# ---------- gh_cpython: Python ----------
# -*- coding: utf-8 -*-
""" 
Python Script
Created on  Wednesday July 2018 06:06:53 
@author:  Kam-Ming Mark Tam 

[desc]
Description of the plugin Here
Write here any thing... 
[/desc]

ARGUMENTS:
----------
<inp> 
    _input :[required] - [type = int] - [default = None] 
    Descripe your input here 
        * bullet point.
        * bullet point
</inp>
<inp>
    Other inputs go here ...
</inp>

RETURN:
----------
    <out>
        output_ : indicate your output description here. \n refers to a new line.
    </out>

"""

_model =
# ---------- end gh_cpython ----------
panel_3 = Panel(ant_linear_models.log)
construct_point = ConstructPoint(XCoordinate=cross_reference.ListListA, YCoordinate=cross_reference.ListListB, ZCoordinate=0)
size = Size(count_4)
point = Point(construct_point)
partition_list = PartitionList(List=point, Size=size)  # -> simplify(Chunks)
point_2 = Point(partition_list)
point_3 = Point(partition_list)
image_sampler = ImageSampler(
    point_3,
    FilePath="C:\Users\Kam-Ming Mark Tam\Desktop\800px-Mona_Lisa,_by_Leonardo_da_Vinci,_from_C2RMF_retouched.jpg",
    Filter="Colour",
    Interpolate=True,
    Umax=1,
    Umin=0,
    Vmax=1,
    Vmin=0,
    Wrap=1)
data = Data(image_sampler)
data_2 = Data(Slider(200, range=0..1000))
data_3 = Data(",")
text_split = TextSplit(Text=data, Separators=data_3)
list_item = ListItem(List=text_split, Index=0, Wrap=True)  # -> Item, Item1, Item2
random = Random(Range="-1 to 1", Number=data_2, Seed="1")
random_2 = Random(Range="-2 to 2", Number=data_2, Seed="2")
random_3 = Random(Range="0 to 10", Number=data_2, Seed="0")
trim_tree = TrimTree(Tree=list_item.Item1, Depth=1)
trim_tree_2 = TrimTree(Tree=list_item.Item2, Depth=1)
trim_tree_3 = TrimTree(Tree=list_item.Item, Depth=1)
number_4 = Number(random)
number_5 = Number(random_3)
number_6 = Number(random_2)
addition_2 = Addition(A=number_5, B=number_6)
data_4 = Data(simplify(trim_tree_2))
data_5 = Data(simplify(trim_tree_3))
data_6 = Data(simplify(trim_tree))
addition_3 = Addition(A=number_5, B=number_4)
number_7 = Number(number_5)
number_8 = Number(addition_3)
number_9 = Number(addition_2)
integer = Integer(Slider(50, range=0..1000))
data_7 = Data(data_4)
data_8 = Data(data_5)
data_9 = Data(data_6)
construct_point_2 = ConstructPoint(XCoordinate=number_7, YCoordinate=number_8, ZCoordinate=number_9)
merge_2 = Merge(Data1=simplify(graft(number_7)), Data2=simplify(graft(number_8)), Data3=simplify(graft(number_9)))
number_10 = Number(data_9)
integer_2 = Integer(integer)
integer_3 = Integer(integer)
number_11 = Number(data_7)
number_12 = Number(data_8)
integer_4 = Integer(integer)
cluster = Cluster(number=number_11, integer=integer_2)  # -> number_7, number_9, number_8
cluster_2 = Cluster(number=number_12, integer=integer_4)  # -> number_7, number_9, number_8
cluster_3 = Cluster(number=number_10, integer=integer_3)  # -> number_7, number_9, number_8
number_13 = Number(merge_2)
point_4 = Point(construct_point_2)
number_14 = Number(number_13)
point_5 = Point(point_4)
cluster_4 = Cluster_2(number=number_14)  # -> number_6, number_7
average = Average(Input=point_5)
number_15 = Number(cluster_4.number_6)
number_16 = Number(cluster_4.number_7)
point_6 = Point(average)
number_17 = Number(cluster_2.number_7)
number_18 = Number(cluster_2.number_9)
number_19 = Number(cluster_3.number_7)
number_20 = Number(cluster_3.number_9)
number_21 = Number(cluster.number_9)
number_22 = Number(cluster.number_7)
list_item_2 = ListItem(List=number_16, Index=0, Wrap=True)  # -> Item, Item1, Item2
vector_xyz = VectorXYZ(XComponent=list_item_2.Item, YComponent=list_item_2.Item1, ZComponent=list_item_2.Item2)  # -> Vector, Length
number_23 = Number(cluster_3.number_8)
number_24 = Number(cluster.number_8)
number_25 = Number(cluster_2.number_8)
colour_rgb = ColourRGB(Alpha=255, Red=number_25, Green=number_23, Blue=number_24)
vector = Vector(vector_xyz.Vector)
colour_rgb_2 = ColourRGB(Alpha=255, Red=data_5, Green=data_6, Blue=data_4)
shader = Shader(colour_rgb)
geometry = Geometry(point_3)
panel_4 = Panel(vector)
point_7 = Point(point_6)
vector_2 = Vector(vector)
colour = Colour(RGB(0, 0, 0))
width = Width(Slider(5, range=0..10))
vector_display_ex = VectorDisplayEx(Point=point_7, Vector=vector_2, Colour=colour, Width=width)
# Original
custom_preview = CustomPreview(Geometry=point_3, Shader=colour_rgb_2)
# Transformed Data from n Components
custom_preview_2 = CustomPreview(Geometry=geometry, Shader=shader)

# ==== cluster Cluster
number = ClusterInput()
integer = ClusterInput()
number_2 = Number(number)
integer_2 = Integer(integer)
tree_statistics = TreeStatistics(Tree=number_2)  # -> Paths, Length, Count
list_item = ListItem(List=tree_statistics.Length, Index=0, Wrap=True)
number_3 = Number(flatten(number_2))
integer_3 = Integer(list_item)
integer_4 = Integer(tree_statistics.Count)
panel = Panel(integer_3)
panel_2 = Panel(integer_4)
gh_cpython = GH_CPython(data=number_3, n_features=integer_3, n_samples=integer_4, n_components=integer_2)  # -> components_list, X_tr_pca_list, X2_list; inputs data: list, n_features: list, n_samples: list, n_components: list
# ---------- gh_cpython: Python ----------
# -*- coding: utf-8 -*-
""" 
Python Script
Created on  Friday July 2018 05:49:40 
@author:  Kam-Ming Mark Tam 

[desc]
Description of the plugin Here
Write here any thing... 
[/desc]

ARGUMENTS:
----------
<inp> 
    _input :[required] - [type = int] - [default = None] 
    Descripe your input here 
        * bullet point.
        * bullet point
</inp>
<inp>
    Other inputs go here ...
</inp>

RETURN:
----------
    <out>
        output_ : indicate your output description here. \n refers to a new line.
    </out>

"""

import numpy as np
import pickle


_data = np.reshape(_data,(_n_samples,_n_features))


def main( _data, _n_components):
    try:
        exec("from sklearn.decomposition import PCA")
        
        exec("pca = PCA()")
        
        try:
            X_tr_pca_ = pca.fit_transform(_data)

            components_ = pca.components_
            components_re = components_[:,:_n_components]
            components_re_T = components_re.T
            
            X_tr2_pca_ = _data.dot(components_re)
            print X_tr2_pca_.shape
           

            X_tr2_pca_= _data.dot(components_re)
            X2 = X_tr2_pca_.dot(components_re_T)

            X2_list_ = str(X2.flatten().tolist())
            X_tr_pca_list_ = str(X_tr_pca_.flatten().tolist())
            components_list_ = str(components_.flatten().tolist())
            
            len_X_tr_pca_list_ = (len(X_tr_pca_list_))
            X_tr_pca_list_= X_tr_pca_list_[1:len_X_tr_pca_list_-2]
            
            len_components_list_ = (len(components_list_))
            components_list_= components_list_[1:len_components_list_-2]   

            len_X2_list_ = (len(X2_list_))
            X2_list_ = X2_list_[1:len_X2_list_-2]

        except:
            print 'Failed fit'

    except Exception as e:
        print str(e)
        print 'Failed initialization'


    return X_tr_pca_list_,components_list_,X2_list_


has_data = _data is not None

if(all([has_data])):
    X_tr_pca_list_,components_list_,X2_list_ = main( _data, _n_components)
else:
    print "Please Complete all the required data"
# ---------- end gh_cpython ----------
text_split = TextSplit(Text=gh_cpython.X_tr_pca_list, Separators=",")
text_split_2 = TextSplit(Text=gh_cpython.components_list, Separators=",")
text_split_3 = TextSplit(Text=gh_cpython.X2_list, Separators=",")
data = Data(text_split)
data_2 = Data(text_split_3)
data_3 = Data(text_split_2)
integer_5 = Integer(integer_4)
partition_list = PartitionList(List=data_3, Size=integer_5)  # -> simplify(Chunks)
partition_list_2 = PartitionList(List=data, Size=integer_5)  # -> simplify(Chunks)
partition_list_3 = PartitionList(List=data_2, Size=integer_5)  # -> simplify(Chunks)
number_4 = Number(partition_list)
number_5 = Number(partition_list_3)
number_6 = Number(partition_list_2)
number_7 = ClusterOutput(number_4)
number_8 = ClusterOutput(number_5)
number_9 = ClusterOutput(number_6)

# ==== cluster Cluster_2
number = ClusterInput()
number_2 = Number(number)
tree_statistics = TreeStatistics(Tree=number_2)  # -> Paths, Length, Count
list_item = ListItem(List=tree_statistics.Length, Index=0, Wrap=True)
number_3 = Number(flatten(number_2))
integer = Integer(tree_statistics.Count)
integer_2 = Integer(list_item)
panel = Panel(integer_2)
panel_2 = Panel(integer)
integer_3 = Integer(panel)
gh_cpython = GH_CPython(data=number_3, n_features=integer_2, n_samples=integer)  # -> components_list, X_tr_pca_list; inputs data: list, n_features: list, n_samples: list
# ---------- gh_cpython: Python ----------
# -*- coding: utf-8 -*-
""" 
Python Script
Created on  Friday July 2018 05:49:40 
@author:  Kam-Ming Mark Tam 

[desc]
Description of the plugin Here
Write here any thing... 
[/desc]

ARGUMENTS:
----------
<inp> 
    _input :[required] - [type = int] - [default = None] 
    Descripe your input here 
        * bullet point.
        * bullet point
</inp>
<inp>
    Other inputs go here ...
</inp>

RETURN:
----------
    <out>
        output_ : indicate your output description here. \n refers to a new line.
    </out>

"""

import numpy as np
import pickle


_data = np.reshape(_data,(_n_samples,_n_features))
print _data.shape

def main( _data):
    try:
        exec("from sklearn.decomposition import PCA")
        
        exec("pca = PCA()")
        
        try:
            X_tr_pca_ = pca.fit_transform(_data)
            components_ = pca.components_
            
            
            
            X_tr_pca_list_ = str(X_tr_pca_.flatten().tolist())
            components_list_ = str(components_.flatten().tolist())
            
            len_X_tr_pca_list_ = (len(X_tr_pca_list_))
            X_tr_pca_list_= X_tr_pca_list_[1:len_X_tr_pca_list_-2]
            
            len_components_list_ = (len(components_list_))
            components_list_= components_list_[1:len_components_list_-2]   

        except:
            print 'Failed fit'

    except Exception as e:
        print str(e)
        print 'Failed initialization'


    return X_tr_pca_list_,components_list_


has_data = _data is not None

if(all([has_data])):
    X_tr_pca_list_,components_list_ = main( _data)
else:
    print "Please Complete all the required data"
# ---------- end gh_cpython ----------
text_split = TextSplit(Text=gh_cpython.components_list, Separators=",")
text_split_2 = TextSplit(Text=gh_cpython.X_tr_pca_list, Separators=",")
data = Data(text_split_2)
data_2 = Data(text_split)
integer_4 = Integer(integer_3)
partition_list = PartitionList(List=data_2, Size=integer_4)  # -> simplify(Chunks)
partition_list_2 = PartitionList(List=data, Size=integer_4)  # -> simplify(Chunks)
number_4 = Number(partition_list_2)
number_5 = Number(partition_list)
number_6 = ClusterOutput(number_4)
number_7 = ClusterOutput(number_5)
